% Simulink data dictionary Clark.sldd

i_a = Simulink.Signal(StorageClass="ExportedGlobal", DataType="single")
i_b = Simulink.Signal(StorageClass="ExportedGlobal", DataType="single")
i_c = Simulink.Signal(StorageClass="ExportedGlobal", DataType="single")