% Simulink data dictionary park.sldd

i_a = Simulink.Signal(StorageClass="ExportedGlobal", DataType="single")
i_b = Simulink.Signal(StorageClass="ExportedGlobal", DataType="single")
i_c = Simulink.Signal(StorageClass="ExportedGlobal", DataType="single")
electric_theta = Simulink.Signal(StorageClass="ExportedGlobal", DataType="single")
i_d = Simulink.Signal(StorageClass="ExportedGlobal", DataType="single")
i_q = Simulink.Signal(StorageClass="ExportedGlobal", DataType="single")
i_alpha = Simulink.Signal(StorageClass="ExportedGlobal", DataType="single")
i_beta = Simulink.Signal(StorageClass="ExportedGlobal", DataType="single")