% Simulink data dictionary svpwm.sldd

i_a = Simulink.Signal(StorageClass="ExportedGlobal", DataType="single")
i_b = Simulink.Signal(StorageClass="ExportedGlobal", DataType="single")
i_c = Simulink.Signal(StorageClass="ExportedGlobal", DataType="single")
electric_theta = Simulink.Signal(StorageClass="ExportedGlobal", DataType="single")
i_alpha = Simulink.Signal(StorageClass="ExportedGlobal", DataType="single")
i_beta = Simulink.Signal(StorageClass="ExportedGlobal", DataType="single")
i_d = Simulink.Signal(StorageClass="ExportedGlobal", DataType="single")
i_q = Simulink.Signal(StorageClass="ExportedGlobal", DataType="single")
Pn = Simulink.Parameter(4, StorageClass="Struct", StructName="motor", DataType="single")
Rs = Simulink.Parameter(6.97, StorageClass="Struct", StructName="motor", DataType="single")
L = Simulink.Parameter(0.00535, StorageClass="Struct", StructName="motor", DataType="single")
flux = Simulink.Parameter(0.016884, StorageClass="Struct", StructName="motor", DataType="single")