% Simulink data dictionary FOC.sldd

Pn = Simulink.Parameter(4, StorageClass="Struct", StructName="Motor", DataType="single")
Rs = Simulink.Parameter(6.97, StorageClass="Struct", StructName="Motor", DataType="single")
L = Simulink.Parameter(0.00535, StorageClass="Struct", StructName="Motor", DataType="single")
flux = Simulink.Parameter(0.016884, StorageClass="Struct", StructName="Motor", DataType="single")
spd_kp = Simulink.Parameter(0.3389, StorageClass="ExportedGlobal", DataType="single")
spd_ki = Simulink.Parameter(0.0144, StorageClass="ExportedGlobal", DataType="single")
i_alpha = Simulink.Signal(StorageClass="ExportedGlobal", DataType="single")
i_beta = Simulink.Signal(StorageClass="ExportedGlobal", DataType="single")
i_d = Simulink.Signal(StorageClass="ExportedGlobal", DataType="single")
i_q = Simulink.Signal(StorageClass="ExportedGlobal", DataType="single")
CurrKp = Simulink.Parameter(0.17, StorageClass="ExportedGlobal", DataType="single")
CurrKi = Simulink.Parameter(35, StorageClass="ExportedGlobal", DataType="single")
ThetaOpen = Simulink.Signal(StorageClass="ExportedGlobal", DataType="single")