% Simulink data dictionary Pulsed_HFI.sldd

spd_kp = Simulink.Parameter(0.3389, StorageClass="ExportedGlobal", DataType="single")
spd_ki = Simulink.Parameter(0.0144, StorageClass="ExportedGlobal", DataType="single")
i_alpha = Simulink.Signal(StorageClass="ExportedGlobal", DataType="single")
i_beta = Simulink.Signal(StorageClass="ExportedGlobal", DataType="single")
i_q = Simulink.Signal(StorageClass="ExportedGlobal", DataType="single")
i_d = Simulink.Signal(StorageClass="ExportedGlobal", DataType="single")
CurrKpd = Simulink.Parameter(0.085, DataType="single")
CurrKi = Simulink.Parameter(35, DataType="single")
CurrKpq = Simulink.Parameter(0.17, DataType="single")
flux = Simulink.Parameter(0.016884)
Ld = Simulink.Parameter(0.002675)
Rs = Simulink.Parameter(6.97, DataType="single")
Pn = Simulink.Parameter(4, DataType="single")
Lq = Simulink.Parameter(0.00535, DataType="single")
ih_beta = Simulink.Signal(DataType="single")
ih_alpha = Simulink.Signal(StorageClass="ExportedGlobal", DataType="single")
il_d = Simulink.Signal(DataType="single")
il_q = Simulink.Signal(DataType="single")
ih_q = Simulink.Signal(DataType="single")
ih_d = Simulink.Signal(DataType="single")
il_alpha = Simulink.Signal(DataType="single")
il_beta = Simulink.Signal(DataType="single")
PLL_Ki = Simulink.Parameter(40000, DataType="single")
PLL_Kd = Simulink.Parameter(10000, DataType="single")