% Simulink data dictionary Square_HFI.sldd

il_alpha = Simulink.Signal(DataType="single")
il_beta = Simulink.Signal(DataType="single")
il_d = Simulink.Signal(DataType="single")
il_q = Simulink.Signal(DataType="single")
ih_alpha = Simulink.Signal(DataType="single")
ih_beta = Simulink.Signal(DataType="single")
ih_d = Simulink.Signal(DataType="single")
ih_q = Simulink.Signal(DataType="single")
spd_kp = Simulink.Parameter(0.3389, DataType="single")
spd_ki = Simulink.Parameter(0.0144, DataType="single")
CurrKpd = Simulink.Parameter(0.085, DataType="single")
CurrKi = Simulink.Parameter(35, DataType="single")
CurrKpq = Simulink.Parameter(0.17, DataType="single")
Pn = Simulink.Parameter(4, DataType="single")
Rs = Simulink.Parameter(6.97, DataType="single")
Ld = Simulink.Parameter(0.002675, DataType="single")
Lq = Simulink.Parameter(0.00535, DataType="single")
flux = Simulink.Parameter(0.016884, DataType="single")
PLL_Ki = Simulink.Parameter(80000, DataType="single")
PLL_Kd = Simulink.Parameter(20000, DataType="single")