% Simulink data dictionary currloop.sldd

Pn = Simulink.Parameter(4, StorageClass="Struct", StructName="Motor", DataType="single")
Rs = Simulink.Parameter(6.97, StorageClass="Struct", StructName="Motor", DataType="single")
L = Simulink.Parameter(0.00535, StorageClass="Struct", StructName="Motor", DataType="single")
flux = Simulink.Parameter(0.016884, StorageClass="Struct", StructName="Motor", DataType="single")
Ubus = Simulink.Parameter(24)
CurrKp = Simulink.Parameter(0.17)
CurrKi = Simulink.Parameter(35)