% Simulink data dictionary speedloop.sldd

Ubus = Simulink.Parameter(24)
Pn = Simulink.Parameter(4, StorageClass="Struct", StructName="Motor", DataType="single")
Rs = Simulink.Parameter(6.97, StorageClass="Struct", StructName="Motor", DataType="single")
L = Simulink.Parameter(0.00535, StorageClass="Struct", StructName="Motor", DataType="single")
flux = Simulink.Parameter(0.016884, StorageClass="Struct", StructName="Motor", DataType="single")
CurrKp = Simulink.Parameter(35)
CurrKi = Simulink.Parameter(0.17)
SpeedKp = Simulink.Parameter(0.03389)
SpeedKi = Simulink.Parameter(0.0144)