% Simulink data dictionary SVPWM.sldd

Udc = Simulink.Parameter(24, StorageClass="ExportedGlobal", DataType="single")
Pn = Simulink.Parameter(4, StorageClass="Struct", StructName="motor", DataType="single")
Rs = Simulink.Parameter(6.97, StorageClass="Struct", StructName="motor", DataType="single")
L = Simulink.Parameter(0.00535, StorageClass="Struct", StructName="motor", DataType="single")
flux = Simulink.Parameter(0.016884, StorageClass="Struct", StructName="motor", DataType="single")